# Grasshopper definition example_0_basic_setup.ghx (Grasshopper 1.0.7)
# plug-ins: KUKA|prc - parametric robot control

# ---- group: Gripper
mesh = Mesh(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)
custom_tool = CustomToolForKUKAPrc(
    CustomToolGeometry=mesh,
    toolid=1,
    toolvala=0,
    toolvalb=-90,
    toolvalc=0,
    toolvalx=0,
    toolvaly=0,
    toolvalz=360,
    valuesset=True)

# ----
kr_90_270_r2500 = KUKAQuantecKR90KR270R2500(highresactive=False)

# ---- group: RAC-Coon Workcell
mesh_2 = Mesh([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])

# ----
pt = Point(Point(978.7569612, 773.9494308, 513.0730928))
pt_2 = Point(Point(-383.2585721, 784.883383, 0))
pt_3 = Point(Point(2503.896293, -571.4120269, 1105.876889))
pt_4 = Point(Point(3420.097401, -849.2612852, 513.0730928))
pl = ConstructPlane(Origin=pt, XAxis=Vector(1, 0, 0), YAxis=Vector(0, 1, 0))
pl_2 = ConstructPlane(Origin=pt_2, XAxis=Vector(1, 0, 0), YAxis=Vector(0, 1, 0))
pl_3 = ConstructPlane(Origin=pt_3, XAxis=Vector(1, 0, 0), YAxis=Vector(0, 1, 0))
pl_4 = ConstructPlane(Origin=pt_4, XAxis=Vector(1, 0, 0), YAxis=Vector(0, 1, 0))
ptp_move = KUKAPrcPTPMovement(TargetAsPlane=pl, extaxenabled=False, interpolation="C_PTP")
ptp_move_2 = KUKAPrcPTPMovement(TargetAsPlane=pl_2, extaxenabled=False, interpolation="C_PTP")
lin_move = KUKAPrcLINearMovement(TargetAsPlane=pl_3, extaxenabled=False, interpolation="C_DIS")
lin_move_2 = KUKAPrcLINearMovement(TargetAsPlane=pl_4, extaxenabled=False, interpolation="C_DIS")
merge = Merge(Data1=ptp_move, Data2=ptp_move_2)
merge_2 = Merge(Data1=lin_move, Data2=lin_move_2)
file_name = Panel("W_GROUP_NAME_DATETIME")
file_name_2 = Panel("E_GROUP_NAME_DATETIME")
save_krl_file = Button()
save_krl_file_2 = Button()

# ---- group: West_robot
kuka_prc = KUKAPrcCORE(
    SimulationSlider=Slider(1, range=0..1),
    KUKAPrcCommands=merge,
    KUKAPrcTool=custom_tool,
    KUKAPrcRobot=kr_90_270_r2500,
    SaveToggle=save_krl_file,
    Filename=file_name,
    LINstartspeed=0.5,
    PRC_SaveNameExpose=True,
    PTPstartspeed=45,
    acc_cp=nan,
    acc_ptp=-1,
    basea=0,
    baseb=0,
    basec=0,
    baseindex=0,
    basex=0,
    basey=-2400,
    basez=0,
    camrobformatting="""&ACCESS RVP
&REL 1
&PARAM TEMPLATE = C:\KRC\Roboter\Template\vorgabe
&PARAM EDITMASK = *
[PROJECTNAME]

[SPLITDEFS]

;FOLD INI
;FOLD BASISTECH INI
GLOBAL INTERRUPT DECL 3 WHEN $STOPMESS==TRUE DO IR_STOPM ( )
INTERRUPT ON 3
BAS (#INITMOV,0 )
;ENDFOLD (BASISTECH INI)
;ENDFOLD (INI)

[STARTAXPOS]

[SETPARAMETERS]

[COMMANDS]

END""",
    camrobon=False,
    checkallcolls=False,
    enda01=5,
    enda02=-90,
    enda03=100,
    enda04=5,
    enda05=10,
    enda06=-5,
    ende01=0,
    ende02=0,
    ende03=0,
    ende04=0,
    endindex=0,
    haltatend=True,
    hash=5208,
    initialstatus="ASAXIS",
    int_advance=3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)  # -> RobotGeometry, AnalysisOutput

# ---- group: East_robot
kuka_prc_2 = KUKAPrcCORE(
    SimulationSlider=Slider(0.7673, range=0..1),
    KUKAPrcCommands=merge_2,
    KUKAPrcTool=custom_tool,
    KUKAPrcRobot=kr_90_270_r2500,
    SaveToggle=save_krl_file_2,
    Filename=file_name_2,
    LINstartspeed=0.5,
    PRC_SaveNameExpose=True,
    PTPstartspeed=45,
    acc_cp=nan,
    acc_ptp=-1,
    basea=0,
    baseb=0,
    basec=0,
    baseindex=0,
    basex=-3000,
    basey=2400,
    basez=0,
    camrobformatting="""&ACCESS RVP
&REL 1
&PARAM TEMPLATE = C:\KRC\Roboter\Template\vorgabe
&PARAM EDITMASK = *
[PROJECTNAME]

[SPLITDEFS]

;FOLD INI
;FOLD BASISTECH INI
GLOBAL INTERRUPT DECL 3 WHEN $STOPMESS==TRUE DO IR_STOPM ( )
INTERRUPT ON 3
BAS (#INITMOV,0 )
;ENDFOLD (BASISTECH INI)
;ENDFOLD (INI)

[STARTAXPOS]

[SETPARAMETERS]

[COMMANDS]

END""",
    camrobon=False,
    checkallcolls=False,
    enda01=5,
    enda02=-90,
    enda03=100,
    enda04=5,
    enda05=10,
    enda06=-5,
    ende01=0,
    ende02=0,
    ende03=0,
    ende04=0,
    endindex=0,
    haltatend=True,
    hash=11622,
    initialstatus="ASAXIS",
    int_advance=3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)  # -> RobotGeometry, AnalysisOutput
