# Grasshopper definition example_2_placing_multiple_bricks.ghx (Grasshopper 1.0.7)
# plug-ins: KUKA|prc - parametric robot control

# ----
# West_robot_pallet
pt = Point(Point(210.1999969, 1080.140015, -505.1600037))
pt_2 = Point(Point(220.0399933, 268.1600037, -500.519989))
pt_3 = Point(Point(1233.569946, 282.3399963, -496.480011))

# ----
# East_robot_pallet
pt_4 = Point(Point(3368.27002, -994.3200073, -491.4200134))
pt_5 = Point(Point(3378.870117, -176.3099976, -497.7799988))
pt_6 = Point(Point(2606.820068, -176.2299957, -493.1600037))

# ---- group: Target Center
pt_7 = Point(Point(734.5200195, 552.5800171, -503.6799927))

pt_8 = Point(Point(2918.580078, -537.3499756, -492.6499939))

# ----
gripper_close_waiting_time_sec = Panel("0.5")
gripper_open_waiting_time_sec = Panel("0.5")
average_brick_dimensions_l_w_h_mm = Panel("""180.0
89.0
40.0""")
picking_retraction_distance_mm = Panel("500")
placing_retraction_distance_mm = Panel("400")

# ---- group: Gripper
mesh = Mesh(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)
custom_tool = CustomToolForKUKAPrc(
    CustomToolGeometry=mesh,
    toolid=1,
    toolvala=0,
    toolvalb=-90,
    toolvalc=0,
    toolvalx=0,
    toolvaly=0,
    toolvalz=360,
    valuesset=True)

# ----
kr_90_270_r2500 = KUKAQuantecKR90KR270R2500(infiniterot=False)

# ---- group: East Robot Pick-up Location
pln = Plane(Plane(origin=(4363.629883, -1193.319946, 172.4799957), x=(0, 1, 0), y=(-1, 0, 0)))

# ---- group: West Robot Pick-up Location
pln_2 = Plane(Plane(origin=(-719.4899902, 964.4400024, 163.6100006), x=(0, 1, 0), y=(-1, 0, 0)))

# ---- group: RAC-Coon Workcell
mesh_2 = Mesh([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])

# ----
pl_3pt = Plane3Pt(PointA=pt_2, PointB=pt_3, PointC=pt)
pl_3pt_2 = Plane3Pt(PointA=pt_5, PointB=pt_6, PointC=pt_4)

# ---- group: Draw_a_brick_around_the_world_origin
md_slider = MDSlider(
    SliderMode=0,
    slider_value=Point(0.4851721787, 0.2238620665, 0.5),
    x_domain=Domain(0, 750),
    y_domain=Domain(0, 750),
    z_domain=Domain(0, 1))
item = ListItem(List=average_brick_dimensions_l_w_h_mm, Index=0, Wrap=True)  # -> Item, Item1, Item2
pdecon = Deconstruct(Point=md_slider)  # -> XComponent, YComponent, ZComponent
pt_9 = ConstructPoint(XCoordinate=pdecon.XComponent, YCoordinate=pdecon.YComponent, ZCoordinate=expr("x/2", item.Item2))
xy = XYPlane(Origin=pt_9)
rotate = Rotate(Geometry=xy, Angle=degrees(Slider(64.8, range=0..360)), Plane=xy)  # -> Geometry, Transform

md_slider_2 = MDSlider(
    SliderMode=0,
    slider_value=Point(0.9227618706, 0.6112365723, 0.5),
    x_domain=Domain(0, 750),
    y_domain=Domain(0, 750),
    z_domain=Domain(0, 1))
item_2 = ListItem(List=average_brick_dimensions_l_w_h_mm, Index=0, Wrap=True)  # -> Item, Item1, Item2
pdecon_2 = Deconstruct(Point=md_slider_2)  # -> XComponent, YComponent, ZComponent
pt_10 = ConstructPoint(XCoordinate=pdecon_2.XComponent, YCoordinate=pdecon_2.YComponent, ZCoordinate=expr("x/2", item_2.Item2))
xy_2 = XYPlane(Origin=pt_10)
rotate_2 = Rotate(Geometry=xy_2, Angle=degrees(Slider(196.1, range=0..360)), Plane=xy_2)  # -> Geometry, Transform

# ----
merge = Merge(Data1=rotate.Geometry, Data2=rotate_2.Geometry)

# ---- group: Assign_your_bricks
flatten = FlattenTree(Tree=merge, Path="{0}")

# ---- group: Orient_the_bricks_to_the_pallet
xy_3 = XYPlane(Origin=Point(0, 0, 0))
orient = Orient(Geometry=flatten, Source=xy_3, Target=pl_3pt)  # -> Geometry, Transform

# ---- group: How_many_bricks_you_have
lng = ListLength(List=flatten)

# ---- group: West_robot_rest_point
point = Point(Point(11.86464134, 691.9788591, 1050.05139))

# ---- group: East_robot_rest_point
point_2 = Point(Point(3475.451729, -1116.983218, 375.6582392))

# ----
deplane = DeconstructPlane(Plane=pln_2)  # -> Origin, XAxis, YAxis, ZAxis
pl = ConstructPlane(Origin=point, XAxis=deplane.XAxis, YAxis=deplane.YAxis)
deplane_2 = DeconstructPlane(Plane=orient.Geometry)  # -> Origin, XAxis, YAxis, ZAxis
amp = Amplitude(Vector=deplane.ZAxis, Amplitude=picking_retraction_distance_mm)
amp_2 = Amplitude(Vector=deplane_2.ZAxis, Amplitude=placing_retraction_distance_mm)
move = Move(Geometry=pln_2, Motion=amp)  # -> Geometry, Transform
move_2 = Move(Geometry=orient.Geometry, Motion=amp_2)  # -> Geometry, Transform
gripper_close_commands = Panel("""$OUT[1]=FALSE
$OUT[2]=TRUE""")
gripper_open_commands = Panel("""$OUT[2]=FALSE
$OUT[1]=TRUE""")
# Go to the plane above the pick-up plane
ptp_move = KUKAPrcPTPMovement(TargetAsPlane=move.Geometry, extaxenabled=False, interpolation="C_PTP")
# Go to the pick-up plane
lin_move = KUKAPrcLINearMovement(TargetAsPlane=pln_2, extaxenabled=False, interpolation="C_VEL")
panel = Panel("Close the Gripper")
custom_krl = KUKAPrcCustomKRL(TextAsKRL=gripper_close_commands)
# Wait a little bit until the gripper is fully close
wait = KUKAPrcWait(KUKAPrcWait=gripper_close_waiting_time_sec)
# Go back to the plane above the pick-up plane
lin_move_2 = KUKAPrcLINearMovement(TargetAsPlane=move.Geometry, extaxenabled=False, interpolation="C_DIS")
# Go to the rest position
ptp_move_2 = KUKAPrcPTPMovement(TargetAsPlane=pl, extaxenabled=False, interpolation="C_PTP")
# Go to the plane above the placing plane
ptp_move_3 = KUKAPrcPTPMovement(TargetAsPlane=move_2.Geometry, extaxenabled=False, interpolation="C_PTP")
# Go to the placing plane
lin_move_3 = KUKAPrcLINearMovement(TargetAsPlane=orient.Geometry, extaxenabled=False, interpolation="C_VEL")
panel_2 = Panel("Open the Gripper")
custom_krl_2 = KUKAPrcCustomKRL(TextAsKRL=gripper_open_commands)
# Wait a little bit until the gripper is fully open
wait_2 = KUKAPrcWait(KUKAPrcWait=gripper_open_waiting_time_sec)
# Go back to the plane above the placing plane
lin_move_4 = KUKAPrcLINearMovement(TargetAsPlane=move_2.Geometry, extaxenabled=False, interpolation="C_DIS")
repeat = RepeatData(Data=ptp_move, Length=lng)
repeat_2 = RepeatData(Data=lin_move, Length=lng)
repeat_3 = RepeatData(Data=custom_krl, Length=lng)
repeat_4 = RepeatData(Data=wait, Length=lng)
repeat_5 = RepeatData(Data=lin_move_2, Length=lng)
repeat_6 = RepeatData(Data=ptp_move_2, Length=lng)
repeat_7 = RepeatData(Data=custom_krl_2, Length=lng)
repeat_8 = RepeatData(Data=wait_2, Length=lng)
cmd_weave = CommandWeaver(
    Command1=repeat,
    Command2=repeat_2,
    Command3=repeat_3,
    Command4=repeat_4,
    Command5=repeat_5,
    Command6=repeat_6,
    Command7=ptp_move_3,
    Command8=lin_move_3,
    Command9=repeat_7,
    Command10=repeat_8,
    Command11=lin_move_4,
    Command12=repeat_6,
    enabletree=False)
# open the gripper in advance in case the gripper is still close from the previous run
merge_2 = Merge(Data1=ptp_move_2, Data2=custom_krl_2, Data3=wait_2, Data4=cmd_weave)  # -> flatten(Result)
number_slider = Slider(0.7883, range=0..1)  # disabled
relay = Relay([orient.Geometry, pln_2])
file_name = Panel("E_GROUP_NAME_DATETIME")  # disabled
file_name_2 = Panel("W_GROUP_NAME_DATETIME")

# ---- group: Visualize_the_bricks
item_3 = ListItem(List=average_brick_dimensions_l_w_h_mm, Index=0, Wrap=True)  # -> Item, Item1, Item2
box = CenterBox(Base=relay, X=expr("x/2", item_3.Item), Y=expr("x/2", item_3.Item1), Z=expr("x/2", item_3.Item2))

# ---- group: Visualize_the_pallet
deplane_3 = DeconstructPlane(Plane=pl_3pt_2)  # -> Origin, XAxis, YAxis, ZAxis
box_2 = CenterBox(Base=pt_8, X=500, Y=500, Z=60)
move_3 = Move(Geometry=box_2, Motion=expr("x*(-60)", deplane_3.ZAxis))  # -> Geometry, Transform

deplane_4 = DeconstructPlane(Plane=pl_3pt)  # -> Origin, XAxis, YAxis, ZAxis
box_3 = CenterBox(Base=pt_7, X=500, Y=500, Z=60)
move_4 = Move(Geometry=box_3, Motion=expr("x*(-60)", deplane_4.ZAxis))  # -> Geometry, Transform

# ----
save_krl_file = Button()
save_krl_file_2 = Button()  # disabled

# ---- group: West_robot
kuka_prc = KUKAPrcCORE(
    SimulationSlider=Slider(0, range=0..1),
    KUKAPrcCommands=merge_2,
    KUKAPrcTool=custom_tool,
    KUKAPrcRobot=kr_90_270_r2500,
    SaveToggle=save_krl_file,
    Filename=file_name_2,
    PRC_BaseExpose=False,
    PRC_SaveNameExpose=True,
    PRCsettings="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")  # -> RobotGeometry, AnalysisOutput

# ---- group: East_robot
kuka_prc_2 = KUKAPrcCORE(
    SimulationSlider=number_slider,
    KUKAPrcCommands=merge_2,
    KUKAPrcTool=custom_tool,
    KUKAPrcRobot=kr_90_270_r2500,
    SaveToggle=save_krl_file_2,
    Filename=file_name,
    PRC_BaseExpose=False,
    PRC_SaveNameExpose=True,
    PRCsettings="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")  # -> RobotGeometry, AnalysisOutput; disabled
