# Grasshopper definition example_3_generating_brick_pillar_by_python.ghx (Grasshopper 1.0.7)
# plug-ins: KUKA|prc - parametric robot control

# ----
# West_robot_pallet
pt = Point(Point(210.1999969, 1080.140015, -505.1600037))
pt_2 = Point(Point(220.0399933, 268.1600037, -500.519989))
pt_3 = Point(Point(1233.569946, 282.3399963, -496.480011))

# ----
# East_robot_pallet
pt_4 = Point(Point(3368.27002, -994.3200073, -491.4200134))
pt_5 = Point(Point(3378.870117, -176.3099976, -497.7799988))
pt_6 = Point(Point(2606.820068, -176.2299957, -493.1600037))

# ---- group: Target Center
pt_7 = Point(Point(734.5200195, 552.5800171, -503.6799927))

pt_8 = Point(Point(2918.580078, -537.3499756, -492.6499939))

# ----
gripper_close_waiting_time_sec = Panel("0.5")
gripper_open_waiting_time_sec = Panel("0.5")
traveling_speed = Panel("45")
average_brick_dimensions_l_w_h_mm = Panel("""180.0
89.0
40.0""")
picking_retraction_distance_mm = Panel("500")
placing_retraction_distance_mm = Panel("400")

# ---- group: Gripper
mesh = Mesh(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)
custom_tool = CustomToolForKUKAPrc(
    CustomToolGeometry=mesh,
    toolid=1,
    toolvala=0,
    toolvalb=-90,
    toolvalc=0,
    toolvalx=0,
    toolvaly=0,
    toolvalz=360,
    valuesset=True)

# ----
kr_90_270_r2500 = KUKAQuantecKR90KR270R2500(infiniterot=False)

# ---- group: East Robot Pick-up Location
pln = Plane(Plane(origin=(4363.629883, -1193.319946, 172.4799957), x=(0, 1, 0), y=(-1, 0, 0)))

# ---- group: West Robot Pick-up Location
pln_2 = Plane(Plane(origin=(-719.4899902, 964.4400024, 163.6100006), x=(0, 1, 0), y=(-1, 0, 0)))

# ---- group: RAC-Coon Workcell
mesh_2 = Mesh([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])

# ----
pl_3pt = Plane3Pt(PointA=pt_2, PointB=pt_3, PointC=pt)
pl_3pt_2 = Plane3Pt(PointA=pt_5, PointB=pt_6, PointC=pt_4)

pallet_z_offset_mm = Panel("0")
deplane = DeconstructPlane(Plane=pl_3pt)  # -> Origin, XAxis, YAxis, ZAxis
amp = Amplitude(Vector=deplane.ZAxis, Amplitude=pallet_z_offset_mm)
move = Move(Geometry=pl_3pt, Motion=amp)  # -> Geometry, Transform

cp = CurrentPath(filename="brick_column.py")  # -> path
# ---------- cp: Python ----------
"""
Export the path of the current GH file.
"""

import Grasshopper

path = ghenv.Component.OnPingDocument().FilePath
path = str(path).split('\\')

path.pop()
if filename is None:
    filename = ""
path.append(filename)
delimiter = '\\'
path = delimiter.join(path)

# print(path)
# ---------- end cp ----------
file = ReadFile(File=cp, PerLineParse=False)

cp_2 = CurrentPath(filename="brick_interpreter.py")  # -> path; same code as cp
file_2 = ReadFile(File=cp_2, PerLineParse=False)

# ---- group: Assign a surface
srf = Surface(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)

# ---- group: Assign a reference point (origin) for the surface
point = Point(Point(-3214.627998, 283.0905072, 0))

# ----
xy = XYPlane(Origin=point)
orient = Orient(Source=xy, Target=move.Geometry)  # -> Geometry, Transform
ghpython_script = GhPythonScript(Code=file, Brick_dim=average_brick_dimensions_l_w_h_mm, Srf=srf, Preferred_plane=pln_2)  # -> Out, Bricks, Debug

# ---- group: Visualize_bricks
python = GhPythonScript(Code=file_2, Brick=ghpython_script.Bricks)  # -> Brick_frame, Brick_brep
python_2 = GhPythonScript(Code=file_2, Brick=ghpython_script.Bricks, Transform=orient.Transform)  # -> Brick_frame, Brick_brep
swatch = ColourSwatch(SwatchColor=RGB(58, 105, 255))
wires = BrepWireframe(Brep=python_2.Brick_brep, Density=-1)  # -> flatten(Wireframe)
preview = CustomPreview(Geometry=python_2.Brick_brep, Material=ColourSwatch(SwatchColor=RGBA(59, 104, 255, 32)))
preview_2 = CustomPreview(Geometry=wires, Material=swatch)
preview_3 = CustomPreview(Geometry=python.Brick_brep, Material=swatch)

# ---- group: West_robot_rest_point
point_2 = Point(Point(11.86464134, 691.9788591, 1050.05139))

# ---- group: East_robot_rest_point
point_3 = Point(Point(3475.451729, -1116.983218, 375.6582392))

# ----
deplane_2 = DeconstructPlane(Plane=pln_2)  # -> Origin, XAxis, YAxis, ZAxis
pl = ConstructPlane(Origin=point_2, XAxis=deplane_2.XAxis, YAxis=deplane_2.YAxis)
amp_2 = Amplitude(Vector=deplane_2.ZAxis, Amplitude=picking_retraction_distance_mm)
move_2 = Move(Geometry=pln_2, Motion=amp_2)  # -> Geometry, Transform
gripper_close_commands = Panel("""$OUT[1]=FALSE
$OUT[2]=TRUE""")
gripper_open_commands = Panel("""$OUT[2]=FALSE
$OUT[1]=TRUE""")
# Go to the plane above the pick-up plane
ptp_move = KUKAPrcPTPMovement(TargetAsPlane=move_2.Geometry, Speed=traveling_speed, extaxenabled=False, interpolation="C_PTP")
# Go to the pick-up plane
lin_move = KUKAPrcLINearMovement(TargetAsPlane=pln_2, extaxenabled=False, interpolation="C_VEL")
panel = Panel("Close the Gripper")
custom_krl = KUKAPrcCustomKRL(TextAsKRL=gripper_close_commands)
# Wait a little bit until the gripper is fully close
wait = KUKAPrcWait(KUKAPrcWait=gripper_close_waiting_time_sec)
# Go back to the plane above the pick-up plane
lin_move_2 = KUKAPrcLINearMovement(TargetAsPlane=move_2.Geometry, extaxenabled=False, interpolation="C_DIS")
# Go to the rest position
ptp_move_2 = KUKAPrcPTPMovement(TargetAsPlane=pl, Speed=traveling_speed, extaxenabled=False, interpolation="C_PTP")
panel_2 = Panel("Open the Gripper")
custom_krl_2 = KUKAPrcCustomKRL(TextAsKRL=gripper_open_commands)
# Wait a little bit until the gripper is fully open
wait_2 = KUKAPrcWait(KUKAPrcWait=gripper_open_waiting_time_sec)
number_slider = Slider(0.7883, range=0..1)  # disabled
file_name = Panel("E_GROUP_NAME_DATETIME")  # disabled
file_name_2 = Panel("W_PY_TEST_08251244")

# ---- group: Visualize_the_pallet
deplane_3 = DeconstructPlane(Plane=pl_3pt_2)  # -> Origin, XAxis, YAxis, ZAxis
box = CenterBox(Base=pt_8, X=500, Y=500, Z=60)
move_3 = Move(Geometry=box, Motion=expr("x*(-60)", deplane_3.ZAxis))  # -> Geometry, Transform

deplane_4 = DeconstructPlane(Plane=pl_3pt)  # -> Origin, XAxis, YAxis, ZAxis
box_2 = CenterBox(Base=pt_7, X=500, Y=500, Z=60)
move_4 = Move(Geometry=box_2, Motion=expr("x*(-60)", deplane_4.ZAxis))  # -> Geometry, Transform

# ----
save_krl_file = Button()
save_krl_file_2 = Button()  # disabled

start_from = Panel("0")
end_at = Panel("10")
dom = ConstructDomain(DomainStart=start_from, DomainEnd=end_at)
subset = SubList(List=flatten(ghpython_script.Bricks), Domain=dom, Wrap=True)  # -> List, Index
python_3 = GhPythonScript(Code=file_2, Brick=subset.List, Transform=orient.Transform)  # -> Brick_frame, Brick_brep

preview_4 = CustomPreview(Geometry=python_3.Brick_brep, Material=ColourSwatch(SwatchColor=RGB(58, 105, 255)))

# ---- group: How_many_bricks_you_have
lng = ListLength(List=python_3.Brick_frame)

# ----
how_many_bricks_you_are_going_to_build = Panel(lng)

deplane_5 = DeconstructPlane(Plane=python_3.Brick_frame)  # -> Origin, XAxis, YAxis, ZAxis
amp_3 = Amplitude(Vector=deplane_5.ZAxis, Amplitude=placing_retraction_distance_mm)
move_5 = Move(Geometry=python_3.Brick_frame, Motion=amp_3)  # -> Geometry, Transform
# Go to the plane above the placing plane
ptp_move_3 = KUKAPrcPTPMovement(TargetAsPlane=move_5.Geometry, Speed=traveling_speed, extaxenabled=False, interpolation="C_PTP")
# Go to the placing plane
lin_move_3 = KUKAPrcLINearMovement(TargetAsPlane=python_3.Brick_frame, extaxenabled=False, interpolation="C_VEL")
# Go back to the plane above the placing plane
lin_move_4 = KUKAPrcLINearMovement(TargetAsPlane=move_5.Geometry, extaxenabled=False, interpolation="C_DIS")
repeat = RepeatData(Data=ptp_move, Length=lng)
repeat_2 = RepeatData(Data=lin_move, Length=lng)
repeat_3 = RepeatData(Data=custom_krl, Length=lng)
repeat_4 = RepeatData(Data=wait, Length=lng)
repeat_5 = RepeatData(Data=lin_move_2, Length=lng)
repeat_6 = RepeatData(Data=ptp_move_2, Length=lng)
repeat_7 = RepeatData(Data=custom_krl_2, Length=lng)
repeat_8 = RepeatData(Data=wait_2, Length=lng)
cmd_weave = CommandWeaver(
    Command1=repeat,
    Command2=repeat_2,
    Command3=repeat_3,
    Command4=repeat_4,
    Command5=repeat_5,
    Command6=repeat_6,
    Command7=ptp_move_3,
    Command8=lin_move_3,
    Command9=repeat_7,
    Command10=repeat_8,
    Command11=lin_move_4,
    Command12=repeat_6,
    enabletree=False)
# open the gripper in advance in case the gripper is still close from the previous run
merge = Merge(Data1=ptp_move_2, Data2=custom_krl_2, Data3=wait_2, Data4=cmd_weave)  # -> flatten(Result)
relay = Relay([python_3.Brick_frame, pln_2])

# ---- group: Visualize_the_bricks
item = ListItem(List=average_brick_dimensions_l_w_h_mm, Index=0, Wrap=True)  # -> Item, Item1, Item2
box_3 = CenterBox(Base=relay, X=expr("x/2", item.Item), Y=expr("x/2", item.Item1), Z=expr("x/2", item.Item2))

# ---- group: West_robot
kuka_prc = KUKAPrcCORE(
    SimulationSlider=Slider(0.044, range=0..1),
    KUKAPrcCommands=merge,
    KUKAPrcTool=custom_tool,
    KUKAPrcRobot=kr_90_270_r2500,
    SaveToggle=save_krl_file,
    Filename=file_name_2,
    PRC_BaseExpose=False,
    PRC_SaveNameExpose=True,
    PRCsettings="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")  # -> RobotGeometry, AnalysisOutput

# ---- group: East_robot
kuka_prc_2 = KUKAPrcCORE(
    SimulationSlider=number_slider,
    KUKAPrcCommands=merge,
    KUKAPrcTool=custom_tool,
    KUKAPrcRobot=kr_90_270_r2500,
    SaveToggle=save_krl_file_2,
    Filename=file_name,
    PRC_BaseExpose=False,
    PRC_SaveNameExpose=True,
    PRCsettings="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")  # -> RobotGeometry, AnalysisOutput; disabled
