# Grasshopper definition example_5_reduce_A6_rotation.ghx (Grasshopper 1.0.7)

# Use this component to reduce the A6 rotation.
# It will rotate the input plane(p) by 180 degrees when its angle between the referenced plane(r) exceed 180 degrees.
python = GhPythonScript()  # -> np; inputs p: Plane, r: Plane
# ---------- python: Python ----------
import Rhino.Geometry as rg
import math
if r is None:
    r = rg.Plane(rg.Point3d(0,0,0), rg.Vector3d.XAxis, rg.Vector3d.YAxis)

angle = rg.Vector3d.VectorAngle(p.XAxis, r.XAxis)
if angle >= math.pi / 2:
    vx = -p.XAxis
    vy = -p.YAxis
    np = rg.Plane(p.Origin, vx, vy)
else:
    np = p
# ---------- end python ----------
